# Grasshopper definition converterscript2.gh (Grasshopper 0.9.76)
# plug-ins: Python Interpreter

panel = Panel("C:\Users\mackey\Documents\GitHub\BEnMap\resources\5_building_sample.geojson")
panel_2 = Panel("C:\Users\mackey\Documents\GitHub\BEnMap\resources\Energy_Reporting_Data_Sept2016_CLEAM.csv")
panel_3 = Panel("C:\Users\mackey\Documents\GitHub\BEnMap\resources\10_building_sample.geojson")
python = PythonScript(energyJsonFile=panel_2, geoJsonFile="G:\hackathon_boston_all_buildings.geojson")  # -> matchedIDs; inputs writeIt: Boolean
# ---------- python: Python ----------
import os

if energyJsonFile:
    berdoAddresses = []
    berdoCSV = open(energyJsonFile, 'r')
    for lcount, line in enumerate(berdoCSV):
        if lcount > 6:
            try:
                berdAddress = line.split(",")[19].upper()
                if berdAddress != "NOT AVAILABLE":
                    berdoAddresses.append(berdAddress)
            except:
                pass
    berdoCSV.close()

if geoJsonFile:
    geojson = open(geoJsonFile, 'r')
    
    if writeIt:
        finalJsonFile = open('C:\\Users\\mackey\\Documents\\GitHub\\BEnMap\\resources\\EnergyJson.json', 'wb')
    
    fullTextStr = ""
    for lcount, line in enumerate(geojson):
        if lcount > 5:
            newLine = line.split('null')
            total = ""
            for count, part in enumerate(newLine):
                if count == 0:
                    total = part
                else:
                    total = total + '"Null"' + part
            
            try:
                obj = eval(total)
                address = obj[0]['properties']['PARCEL_ID'].split(',')[0]
                
                if address in berdoAddresses:
                    if writeIt:
                        finalJsonFile.write(line)
                    print address
            except: pass
    
    if writeIt:
        finalJsonFile.close()
    geojson.close()
# ---------- end python ----------
matchedids = Data(["2101829500", "2101829500", "2101829500", "2101831000", "2101463000", "2101463000"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])
microclimatemap = Honeybee_MicroclimateMapAnalysis()  # -> readMe, port, radTempMtx, airTempMtx, operativeTempMtx, adaptComfMtx, degFromTargetMtx, port_2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; plug-in component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
panel_4 = Panel(matchedids)
